vi "Main.gviweb"   [LabVIEW NXG 2.0.0]
panel controls:
  "Sample Length (s)": i32 = 10
  "Signal Amplitude": f64 = 1
  "Sample Rate (Hz)": i32 = 100
  "Noise %": f64 = 25
  "Signal Frequency": f64 = 1
  "Hyperlink Control": string = "https://github.com/ni/webvi-examples/tree/ad0a92c4696674f290b4e2a02c514360be7b299d/Call%20LabVIEW%20Web%20Service"
panel indicators:
  "Observed Data and Fitted Curve": cluster{"Element 1": f64, "Element 2": f64}[][]
  "Signal": cluster{"Element 1": f64, "Element 2": f64}[]
  "Spectrum": cluster{"Element 1": f64, "Element 2": f64}[]
  "URL Image": string
types:
  T1 = cluster{"X": f64[], "Y": f64[], "Best Gaussian Fit": f64[], "Upper Bound": f64[], "Lower Bound": f64[]}
  T2 = cluster{"Samples": i32, "Amplitude": f64, "Frequency": f64, "Noise%": f64}
uses:
  NI::HTTP::GET.gvi
  NI::HTTP::POST Buffer.gvi
diagram:
  # Get data from LabVIEW Web service, unflatten the data, and format it so it can be displayed in a single graph
  s1 = uninitialised  # shift register
  while {
    Wait(time to wait=500)
    call "GET.gvi"(url="http://127.0.0.1:8001/Web_Server/ParametricCurve", error in=s1) -> (body=w1, error out=w2)
    Unflatten From JSON(JSON string=w1, error in (no error)=w2, type and defaults=T1 {all zero or empty}) -> (error out=w3, value=w4)
    Property Node(instance in=w4) -> ("X"=w5, "Y"=w6, "Best Gaussian Fit"=w7, "Upper Bound"=w8, "Lower Bound"=w9)
    Build Index And Bundle Cluster Array(w5, w6) -> (out=w10)
    Build Index And Bundle Cluster Array(w5, w7) -> (out=w11)
    Build Index And Bundle Cluster Array(w5, w8) -> (out=w12)
    Build Index And Bundle Cluster Array(w5, w9) -> (out=w13)
    Build Array(w10, w11, w12, w13) -> w14
    $"Observed Data and Fitted Curve" <- w14
    next s1 = w3
    stop if FALSE
  }
  # Post data to LabVIEW Web service, unflatten the  response data, format the data, and plot on two graphs
  s2 = uninitialised  # shift register
  while {
    Wait(time to wait=1000)
    Divide(x=$"Sample Rate (Hz)", y=2) -> w15
    Multiply($"Sample Length (s)", $"Sample Rate (Hz)") -> w16
    Divide(x=$"Signal Frequency", y=$"Sample Rate (Hz)") -> w17
    Property Node(instance in=T2 {all zero or empty}, "Samples"=w16, "Frequency"=w17, "Amplitude"=$"Signal Amplitude", "Noise%"=$"Noise %") -> (instance out=w18)
    Flatten To JSON(anything=w18, error in (no error)=s2) -> (JSON string=w19, error out=w20)
    call "POST Buffer.gvi"(url="http://127.0.0.1:8001/Web_Server/SignalAndSpectrum", buffer=w19, error in=w20) -> (body=w21, error out=w22)
    w23 = cluster{"Signal": f64[], "Spectrum": f64[]} {all zero or empty}
    Unflatten From JSON(JSON string=w21, error in (no error)=w22, type and defaults=w23) -> (error out=w24, value=w25)
    Property Node(instance in=w25) -> ("Spectrum"=w26, "Signal"=w27)
    Reciprocal(x=$"Sample Length (s)") -> w28
    for (iteration -> i1) {
      w29 = each element of w26
      Multiply(w28, i1) -> w31
      Is Greater(x=w31, y=w15) -> w32
      Build Cluster(w31, w29) -> w33
      append w33 to w30
      stop if w32
    }
    $Spectrum <- w30
    Reciprocal(x=$"Sample Rate (Hz)") -> w34
    for (iteration -> i2) {
      w35 = each element of w27
      Multiply(i2, w34) -> w37
      Build Cluster(w37, w35) -> w38
      append w38 to w36
    }
    $Signal <- w36
    next s2 = w24
    stop if FALSE
  }
