vi "Main.gviweb"   [LabVIEW NXG 3.1.0]
# This example uses the JavaScript Library Interface (JSLI) to connect to a WebSocket Echo Server.
panel controls:
  "Hyperlink Control": string = "https://github.com/ni/webvi-examples/tree/master/ConnectWebVIToWebSocketEchoServer"
  "Message": string
  "Send": bool
  "Disconnect": bool
  "WebSocket Server Url": string = "ws://echo.websocket.org/"
  "Connect": bool
  "Messages": T1[]
panel indicators:
  "Close Error": error
types:
  T1 = cluster{"Source": string, "Time": string, "Message": string}
uses:
  Chat::Record Message.gviweb
  NI::WebSockets::Open WebSocket.gvi
  NI::WebSockets::Write String.gvi
  NI::WebSockets::Close WebSocket.gvi
  NI::G Core::Error::Is Error.gvi
  NI::WebSockets::Read String.gvi
diagram:
  call "Record Message.gviweb"(Reset?=TRUE, Messages reference=reference to "Messages") -> (Error Out=w1)
  event {
    on "Connect" Value changed {
      w2 = w1
    }
  }
  call "Record Message.gviweb"(Message="Connecting...", Direction="Informational", Error In=w2) -> (Error Out=w3)
  # 1. Connect to the WebSocket echo server.
  call "Open WebSocket.gvi"(url=$"WebSocket Server Url", error in=w3) -> (websocket session out=w4, error out=w5)
  call "Record Message.gviweb"(Message="Connected", Direction="Informational", Error In=w5) -> (Error Out=w6)
  # 2. Send a message to the WebSocket server or disconnect by closing the connection.
  s1 = w6  # shift register
  while {
    event {
      on "Send" Value changed {
        call "Write String.gvi"(websocket session in=w4, string message=$Message, error in=s1) -> (error out=w9)
        call "Record Message.gviweb"(Message=$Message, Direction="Outbound", Error In=w9) -> (Error Out=w7)
        w8 = FALSE
      }
      on "Disconnect" Value changed {
        call "Close WebSocket.gvi"(websocket session in=w4, error in=s1) -> (error out=w7)
        w8 = $Disconnect
      }
    }
    call "Is Error.gvi"(error in=w7) -> (error?=w10)
    Logical Or(w10, w8) -> w11
    next s1 = w7
    stop if w11
  }
  $"Close Error" <- s1
  # 3. Wait for a message from the server or for the connection to close / error.
  while {
    call "Read String.gvi"(websocket session in=w4, error in=w6) -> (string response=w12, error out=w13)
    call "Record Message.gviweb"(Message=w12, Direction="Inbound", Error In=w13) -> (Error Out=w14)
    stop if w14
  }
