vi "Main.gviweb"   [LabVIEW NXG 2.0.0]
panel controls:
  "Switch": bool
  "Slider": f64
  "Data Grid": cluster{"A": bool}[]
panel indicators:
  "Intensity Graph": f64[][]
  "Radial Progress Bar": f64
  "Tank": f64
  "Radial Progress Bar_2": f64
  "Radial Progress Bar_3": f64
diagram:
  while {
    $Tank <- $Slider
    Random Number() -> (number (0 to 1)=w1)
    Multiply(10, w1) -> w2
    Multiply($Slider, w2) -> w3
    $"Radial Progress Bar" <- w3
    Wait(time to wait=50)
    for (N = 20) {
      for (N = 50) {
        Random Number() -> (number (0 to 1)=w6)
        Multiply(w6, 100) -> w7
        append w7 to w5
      }
      append w5 to w4
    }
    $"Intensity Graph" <- w4
    stop if FALSE
  }
