vi "MobileTest.gviweb"   [LabVIEW NXG 2.1.0]
panel controls:
  "Button": bool
panel indicators:
  "bool test": bool
  "numeric test": bool
  "string test": bool
  "Output": error
  "test": bool
  "String": string
uses:
  subvis::Initialize.gvi
  subvis::Write Example Tags.gvi
  subvis::Read Example Tags.gvi
diagram:
  w1 = "run test"  # Type
  s1 = w1  # shift register
  while {
    case (s1) {
      frame "run test", Default {
        $String <- "Test Running..."
        for (N = 5) {
          Random Number() -> (number (0 to 1)=w4)
          append w4 to w3
        }
        Array Index(array=w3) -> (out0[_]=w5, out1[_]=w6, out2[_]=w7, out3[_]=w8, out4[_]=w9)
        Round To Nearest(number=w5) -> w10
        Is Equal To 0(x=w10) -> w11
        Multiply(w6, 100) -> w12
        Round To Nearest(number=w12) -> w13
        Format Into String(w7) -> w14
        disable {
          frame Enabled {
            w15 = default
            w16 = default
          }
          frame Disabled {
            # Enter server URL and API key here
            w15 = ""
            w16 = ""
          }
        }
        w17 = ["mobiletest.bool", "mobiletest.numeric", "mobiletest.string", "mobiletest.Inside.Temp", "mobiletest.Outside.Temp"]
        call "Initialize.gvi"(server url=w16, api key=w15, tag paths=w17, AuthPicker="API Key") -> (error out=w18, tags=w19)
        call "Write Example Tags.gvi"(tags in=w19, example.skyline-data-services.int_control=w11, example.skyline-data-services.numeric_slider-control=w13, example.skyline-data-services.string_control=w14, Skyline.Examples.Oven.Inside.Temp-slider-control=w8, Skyline.Examples.Oven.Outside.Temp-slider-control=w9, error in=w18) -> (tags out=w20, errror out=w21)
        sequence {
          frame 0 {
            Wait(time to wait=250)
          }
        }
        call "Read Example Tags.gvi"(tags in=w20, error in=w21) -> (example.skyline-data-services.int_indicator=w22, example.skyline-data-services.numeric_gauge-indicator=w23, example.skyline-data-services.string_indicator=w24, Skyline.Examples.Oven.Outside.Temp-tank-indicator=w25, error out=w26)
        sequence (after w8) (after w25) {
          frame 0 {
            Is Equal(x=w13, y=w23) -> w27
            $"numeric test" <- w27
            Is Equal(x=w11, y=w22) -> w28
            Is Equal(x=w24, y=w14) -> w29
            Property Node(instance in=w26) -> ("status"=w30)
            Not(x=w30) -> w31
            Logical And(w28, w27, w29, w31) -> w32
            $test <- w32
            $"string test" <- w29
            $Output <- w26
            $"bool test" <- w28
          }
        }
        w33 = "wait"  # MobileTestState
        w2 = w33
      }
      frame "wait" {
        Wait(time to wait=100)
        $String <- "Test complete"
        w34 = "run test"  # Type
        w35 = "wait"  # MobileTestState
        Select(s=$Button, t=w34, f=w35) -> w36
        case (w36) {
          frame "run test", Default {
            $"numeric test" <- FALSE
            $"string test" <- FALSE
            $test <- FALSE
            $"bool test" <- FALSE
            $Output <- no error
            w2 = w36
          }
          frame "wait" {
            w2 = w36
          }
        }
      }
    }
    next s1 = w2
    stop if FALSE
  }
