vi "Main.gviweb"   [LabVIEW NXG 2.0.0]
panel controls:
  "Tab": i32
  "example.skyline-data-services.int_control": bool
  "example.skyline-data-services.numeric_slider-control": f64
  "example.skyline-data-services.string_control": string
  "Message to Write": string
  "Button": bool
  "Hyperlink Control": string
  "Hyperlink Control_2": string
  "password": string
  "username": string
  "Button_2": bool
  "server url": string
panel indicators:
  "example.skyline-data-services.int_indicator": bool
  "example.skyline-data-services.numeric_gauge-indicator": f64
  "example.skyline-data-services.string_indicator": string
  "Message Read": string
  "Alert Skyline Error": bool
  "Error": error
types:
  "Client Handle.gtype" = u32
  "Configuration.gtype" = cluster{"Server URL": string, "Session": "Client Handle.gtype"}
  "DataType.gtype" = enum{"Double", "Integer", "String"}
  "Tag Cluster Web.gtype" = cluster{"Path": string, "Data Type": "DataType.gtype", "Value": string, "Time Stamp": timestamp}
  "Tag Cluster HTTP.gtype" = cluster{"Configuration": "Configuration.gtype", "Tag Cluster": "Tag Cluster Web.gtype"}
uses:
  NI::G Core::Error::Clear Error Cluster.gvi
  subvis::Initialize.gvi
  NI::Skyline::TagHTTP::Read Tag (I32).gvi
  NI::Skyline::TagHTTP::Read Tag (DBL).gvi
  NI::Skyline::TagHTTP::Read Tag (String).gvi
  NI::Skyline::TagHTTP::Multi Read.gvi
  NI::Skyline::TagHTTP::Write Tag (I32).gvi
  NI::Skyline::TagHTTP::Write Tag (DBL).gvi
  NI::Skyline::TagHTTP::Write Tag (String).gvi
  NI::Skyline::TagHTTP::Multi Write.gvi
diagram:
  s1 = uninitialised  # shift register
  s2 = uninitialised  # shift register
  s3 = "initialize"  # shift register
  while {
    Wait(time to wait=250)
    Select(s=s1, t=TRUE, f=TRUE) -> w1
    $"Alert Skyline Error" <- w1
    Select(s=s1, t="initialize", f=s3) -> w2
    case (w2) {
      frame 5, Default {
        call "Clear Error Cluster.gvi"(error in=s1) -> (error out=w6)
        call "Initialize.gvi"(server url=$"server url", username=$username, password=$password, error in=w6) -> (error out=w4, tags=w5)
        w3 = "read-tags"
      }
      frame 0 {
        disable {
          frame Enabled {
            Array Index(array=s2) -> (out0[_]=w10, out1[_]=w11, out2[_]=w12)
            call "Read Tag (I32).gvi"(tag in=w10, error in=s1) -> (value=w13)
            Is Not Equal To 0(x=w13) -> w7
            call "Read Tag (DBL).gvi"(tag in=w11, error in=s1) -> (value=w8)
            # Working around bug where multi read has an error in dependency.
            call "Read Tag (String).gvi"(tag in=w12, error in=s1) -> (value=w9)
            w4 = default
            w5 = default
          }
          frame Disabled {
            call "Multi Read.gvi"(tags in=s2, error in=s1) -> (tags out=w5, tag clusters=w14, error out=w15)
            Array Index(array=w14) -> (out0[_]=w16, out1[_]=w17, out2[_]=w18)
            Property Node(instance in=w17) -> ("Value"=w19)
            Scan From String(inputString=w19, errIn=w15) -> (errOut=w20, out0=w8)
            Property Node(instance in=w16) -> ("Value"=w21)
            Scan From String(inputString=w21, errIn=w15, default=FALSE) -> (errOut=w22, out0=w7)
            Merge Errors(w22, w20) -> (error out=w4)
            Property Node(instance in=w18) -> ("Value"=w9)
          }
        }
        $"example.skyline-data-services.int_indicator" <- w7
        $"example.skyline-data-services.numeric_gauge-indicator" <- w8
        $"example.skyline-data-services.string_indicator" <- w9
        w3 = $Tab
      }
      frame 1 {
        Boolean To Integer(Boolean=$"example.skyline-data-services.int_control") -> (0, 1=w23)
        disable {
          frame Enabled {
            Array Index(array=s2) -> (out0[_]=w24, out1[_]=w25, out2[_]=w26)
            call "Write Tag (I32).gvi"(tag in=w24, value=w23, error in=s1) -> (error out=w27)
            call "Write Tag (DBL).gvi"(tag in=w25, value=$"example.skyline-data-services.numeric_slider-control", error in=s1) -> (error out=w28)
            # Working around bug where multi write has an error in dependency.
            call "Write Tag (String).gvi"(tag in=w26, value=$"example.skyline-data-services.string_control", error in=s1) -> (error out=w29)
            Merge Errors(w27, w28, w29) -> (error out=w4)
          }
          frame Disabled {
            Format Into String(errIn=s1, w23) -> (outString=w30, errOut=w31)
            Format Into String(errIn=w31, $"example.skyline-data-services.numeric_slider-control") -> (outString=w32, errOut=w33)
            Build Array(w30, w32, $"example.skyline-data-services.string_control") -> w34
            for {
              w35 = each element of s2
              w36 = each element of w34
              Property Node(instance in=w35) -> ("Configuration"=w38, "Path"=w39, "Datatype"=w40)
              Property Node(instance in="Tag Cluster HTTP.gtype" {all zero or empty}, "Configuration"=w38, "Tag Cluster:Path"=w39, "Tag Cluster:Data Type"=w40, "Tag Cluster:Value"=w36) -> (instance out=w41)
              append w41 to w37
            }
            call "Multi Write.gvi"(tag clusters=w37, error in=w33) -> (error out=w4)
          }
        }
        w3 = $Tab
        w5 = s2
      }
      frame 2 {
        w3 = $Tab
        w4 = s1
        w5 = s2
      }
      frame 3 {
        w3 = w2
        w4 = s1
        w5 = s2
      }
      frame 4 {
        w3 = w2
        w4 = s1
        w5 = s2
      }
    }
    $Error <- w4
    next s1 = w4
    next s2 = w5
    next s3 = w3
    stop if FALSE
  }
