vi "Initialize.gvi"   [LabVIEW NXG 2.0.0]
inputs:
  "server url": string
  "username": string
  "password": string
  "error in": error
outputs:
  "error out": error
  "tags": "Tag.gtype"[]
types:
  "DataType.gtype" = enum{"Double", "Integer", "String"}
  "Client Handle.gtype" = u32
  "Configuration.gtype" = cluster{"Server URL": string, "Session": "Client Handle.gtype"}
  "Tag.gtype" = cluster{"Path": string, "Datatype": "DataType.gtype", "Configuration": "Configuration.gtype"}
uses:
  NI::Skyline::Configuration::Open Configuration.gvi
  NI::Skyline::TagHTTP::Open Tag.gvi
diagram:
  w1 = ["Skyline.Examples.DataServices.bool", "Skyline.Examples.DataServices.numeric", "Skyline.Examples.DataServices.string", "Skyline.Examples.Oven.Inside.Temp", "Skyline.Examples.Oven.Outside.Temp"]
  Build Array("Integer", "Double", "String", "Double", "Double") -> w2
  call "Open Configuration.gvi"(server url=$"server url", username=$username, password=$password, error in=$"error in") -> (configuration=w3, error out=w4)
  for {
    w5 = each element of w1
    w6 = each element of w2
    call "Open Tag.gvi"(path=w5, data type=w6, error in=w4, configuration=w3) -> (tag out=w8, error out=w9)
    append w8 to w7
    stop if w9
  }
  $tags <- w7
  $"error out" <- w9
