vi "Read Example Tags.gvi"   [LabVIEW NXG 2.0.0]
inputs:
  "error in": error
  "tags in": "Tag.gtype"[]
outputs:
  "error out": error
  "example.skyline-data-services.numeric_gauge-indicator": f64
  "example.skyline-data-services.string_indicator": string
  "example.skyline-data-services.int_indicator": bool
  "tags out": "Tag.gtype"[]
types:
  "DataType.gtype" = enum{"Double", "Integer", "String"}
  "Client Handle.gtype" = u32
  "Configuration.gtype" = cluster{"Server URL": string, "Session": "Client Handle.gtype"}
  "Tag.gtype" = cluster{"Path": string, "Datatype": "DataType.gtype", "Configuration": "Configuration.gtype"}
uses:
  NI::Skyline::TagHTTP::Read Tag (I32).gvi
  NI::Skyline::TagHTTP::Read Tag (DBL).gvi
  NI::Skyline::TagHTTP::Read Tag (String).gvi
  NI::Skyline::TagHTTP::Multi Read.gvi
diagram:
  case ($"error in") {
    frame Error, Default {
      w1 = default
      w2 = default
      w3 = default
      w4 = $"error in"
      w5 = $"tags in"
    }
    frame No Error {
      disable {
        frame Enabled {
          Array Index(array=$"tags in") -> (out0[_]=w6, out1[_]=w7, out2[_]=w8)
          call "Read Tag (I32).gvi"(tag in=w6, error in=$"error in") -> (value=w9, error out=w10)
          Is Not Equal To 0(x=w9) -> w1
          call "Read Tag (DBL).gvi"(tag in=w7, error in=$"error in") -> (value=w2, error out=w11)
          call "Read Tag (String).gvi"(tag in=w8, error in=$"error in") -> (value=w3, error out=w12)
          # Working around bug where multi read has an error in dependency.
          Merge Errors(w10, w11, w12) -> (error out=w4)
          w5 = $"tags in"
        }
        frame Disabled {
          call "Multi Read.gvi"(tags in=$"tags in", error in=$"error in") -> (tags out=w5, tag clusters=w13, error out=w14)
          Array Index(array=w13) -> (out0[_]=w15, out1[_]=w16, out2[_]=w17)
          Property Node(instance in=w17) -> ("Value"=w3)
          Property Node(instance in=w16) -> ("Value"=w18)
          Scan From String(inputString=w18, errIn=w14) -> (errOut=w19, out0=w2)
          Property Node(instance in=w15) -> ("Value"=w20)
          Scan From String(inputString=w20, errIn=w14, default=FALSE) -> (errOut=w21, out0=w1)
          Merge Errors(w21, w19) -> (error out=w4)
        }
      }
    }
  }
  $"tags out" <- w5
  $"example.skyline-data-services.int_indicator" <- w1
  $"example.skyline-data-services.string_indicator" <- w3
  $"example.skyline-data-services.numeric_gauge-indicator" <- w2
  $"error out" <- w4
